vi "GET User Info.gvi"   [G Web Development Software 22.0.0]
outputs:
  "User Info": "User Info JSON.gtype"
  "Logged In": bool
  "Error out": error
types:
  "User Info JSON.gtype" = cluster{"email": string, "first_name": string, "last_name": string, "department": string}
uses:
  NI::HTTP::GET.gvi
diagram:
  call "GET.gvi"(url="/user") -> (status code=w1, body=w2, error out=w3)
  case (w1) {
    frame Default {
      w4 = FALSE
      w5 = w3
      w6 = "User Info JSON.gtype" {all zero or empty}
    }
    frame 200 {
      Unflatten From Json(JSON string=w2, error in (no error)=w3, type and defaults="User Info JSON.gtype" {all zero or empty}) -> (error out=w5, value=w6)
      w4 = TRUE
    }
  }
  $"User Info" <- w6
  $"Error out" <- w5
  $"Logged In" <- w4
