vi "Register User.gvi"   [G Web Development Software 22.0.0]
inputs:
  "User Registration": "User Registration.gtype"
outputs:
  "Result Message": string
  "Success": bool
types:
  "User Registration.gtype" = cluster{"Email": string, "Password 1": string, "Password 2": string, "First Name": string, "Last Name": string, "Department": string}
  "User Registration JSON.gtype" = cluster{"email": string, "password": string, "first_name": string, "last_name": string, "department": string}
uses:
  WebApp::Support::POST with Type.gvi
diagram:
  Property Node(instance in=$"User Registration") -> ("Password 1"=w1, "Password 2"=w2, instance out=w3)
  Is Not Equal(x=w1, y=w2) -> w4
  case (w4) {
    frame False, Default {
      Property Node(instance in=w3) -> ("Email"=w7, "Password 1"=w8, "First Name"=w9, "Last Name"=w10, "Department"=w11)
      Property Node(instance in="User Registration JSON.gtype" {all zero or empty}, "email"=w7, "password"=w8, "first_name"=w9, "last_name"=w10, "department"=w11) -> (instance out=w12)
      Flatten To Json(anything=w12) -> (JSON string=w13)
      call "POST with Type.gvi"(URL="/registration", Buffer=w13) -> (status code=w14, body=w5)
      Is Equal(x=w14, y=200) -> w6
    }
    frame True {
      w5 = "The entered passwords do not match."
      w6 = FALSE
    }
  }
  $"Result Message" <- w5
  $Success <- w6
