vi "challenges.gviweb"   [G Web Development Software 22.0.0]
uses:
  NI::HTTP::GET.gvi
  WebApp::Support::Challenges::Challenges.jsli::BuildChallengesList
diagram:
  call "GET.gvi"(url="/challenges") -> (body=w1)
  Obtain JavaScript Reference(reference in=reference to "ChallengesList") -> (javascript reference out=w2)
  call "BuildChallengesList"(placeholder=w2, challengesJSON=w1)
  while {
    event (timeout = 1000) {
      on "Timeout" { }
    }
    stop if FALSE
  }
