vi "index.gviweb"   [G Web Development Software 22.0.0]
panel controls:
  "Login Link": string = "/login.html"
  "Register Link": string = "/register.html"
  "Logout Link": string = "/logout"
  "Challenges": string = "/challenges.html"
uses:
  WebApp::Support::Utilities.jsli::SetInnerHTML
  WebApp::Support::Auth::GET User Info.gvi
diagram:
  w1 = """The <b>Summer of LabVIEW</b> is a global NI Sales and Support event to increase <i>awareness, excitement</i>, and <i>prowess</i> with LabVIEW through a series of <b>coding challenges</b>, preceded by presentations and workshops teaching concepts that are applicable to the coding challenge tasks. Join the conversation about the event on <a href="https://web.yammer.com/main/org/ni.com/groups/eyJfdHlwZSI6Ikdyb3VwIiwiaWQiOiIxMDUxNDYzNzYxOTIifQ/all" target="_blank">our Yammer page</a>.<br>
<br>
To prepare for the event, you'll need to install LabVIEW 2020 or later. Download LabVIEW <a href="https://www.ni.com/en-us/support/downloads/software-products/download.labview.html#443865" target="_blank">here</a>.<br>
<br>
For the first challenge, you will also need to install DQMH from the VIPM Community <a href="https://www.vipm.io/package/delacor_lib_dqmh_toolkit/" target="_blank">here</a>."""
  Obtain JavaScript Reference(reference in=reference to "Intro HTML") -> (javascript reference out=w2)
  call "SetInnerHTML"(placeholder=w2, html=w1)
  s1 = "Init"  # shift register
  while {
    case (s1) {
      frame "Init" {
        Property Node(instance in=reference to "Login Link", "Visible"=FALSE)
        Property Node(instance in=reference to "Register Link", "Visible"=FALSE)
        Property Node(instance in=reference to "Logout Link", "Visible"=FALSE)
        w3 = "Ready"
      }
      frame "Ready" {
        call "GET User Info.gvi"() -> (User Info=w4, Logged In=w5)
        case (w5) {
          frame False, Default { }
          frame True {
            Property Node(instance in=w4) -> ("first_name"=w6)
            Format Into String(formatString="Welcome, %s!", w6) -> w7
            Property Node(instance in=reference to unnamed text, "Text"=w7)
          }
        }
        Not(x=w5) -> w8
        Property Node(instance in=reference to "Login Link", "Visible"=w8)
        Property Node(instance in=reference to "Register Link", "Visible"=w8)
        Property Node(instance in=reference to "Logout Link", "Visible"=w5)
        w3 = "Run"
      }
      frame "Run" {
        Wait(time to wait=100)
        w3 = "Run"
      }
    }
    next s1 = w3
    stop if FALSE
  }
