vi "login.gviweb"   [G Web Development Software 22.0.0]
panel controls:
  "NI Email": string
  "Password": string
  "Login": bool
  "Register Link": string = "/register.html"
types:
  "Login JSON.gtype" = cluster{"Email": string, "Password": string, "CSRF": string}
uses:
  WebApp::Support::Common.jsli::ClearClassFromAll
  WebApp::Support::Auth::Make CSRF Token.gvi
  WebApp::Support::Auth::Login.gvi
diagram:
  call "ClearClassFromAll"(className="initially-hidden")
  call "Make CSRF Token.gvi"(Token ID="login") -> (Token=w1, error out=w2)
  case (w2) {
    frame Error, Default { }
    frame No Error {
      while {
        event {
          on "Login" Value changed {
            Property Node(instance in="Login JSON.gtype" {all zero or empty}, "Email"=$"NI Email", "Password"=$Password, "CSRF"=w1) -> (instance out=w3)
            call "Login.gvi"(Login JSON=w3)
          }
        }
        stop if FALSE
      }
    }
  }
