vi "submit.gviweb"   [G Web Development Software 22.0.0]
panel controls:
  "Upload File": bool
uses:
  WebApp::Support::Auth::GET User Info.gvi
  WebApp::Support::Common.jsli::SetUser
  WebApp::Support::Common.jsli::AddNavLink
  URL::Window Location::Window Location Parameters::Window Location Get Search Parameter.gvi
  WebApp::Support::Common.jsli::SetInnerHTML
  WebApp::Support::Challenges::GET Challenge by ID.gvi
  WebApp::Support::Challenges::Set Challenge Details.gvi
  WebApp::Support::Common.jsli::ClearClassFromAll
  WebApp::Support::Auth::Make CSRF Token.gvi
  Uppy::Set Uppy Core Options.gvi
  Uppy::Set Uppy Dashboard Options.gvi
  Uppy::Request Files.gvi
  WebApp::Support::Submissions::UploadFile.gvi
  WebApp::Support::Submissions::GET Submissions.gvi
  DebugTools::Debug Log.gvi
  WebApp::Support::Submissions::Show Submissions.gvi
diagram:
  call "GET User Info.gvi"() -> (Logged In=w1, User JSON=w2)
  call "SetUser"(loggedIn=w1, userJSON=w2)
  w3 = """There was an error loading the specified challenge. Try reloading the page.

If the problem persists check out the <a href="/help.html">help</a> page."""
  s1 = "Init"  # shift register
  s2 = uninitialised  # shift register
  s3 = uninitialised  # shift register
  s4 = uninitialised  # shift register
  while {
    case (s1) {
      frame "Init" {
        call "AddNavLink"(url="/help.html", text="Help!")
        call "Window Location Get Search Parameter.gvi"(key="id") -> (value=w8)
        Decimal String To Number(default (0 I32)=0, string=w8) -> (number=w6)
        w4 = "Ready"
        w5 = default
        w7 = default
      }
      frame "Ready" {
        Is Greater Than 0(x=s3) -> w9
        case (w9) {
          frame False, Default {
            Obtain JavaScript Reference(reference in=reference to "Description") -> (javascript reference out=w10)
            call "SetInnerHTML"(placeholder=w10, html=w3)
          }
          frame True {
            call "GET Challenge by ID.gvi"(ID=s3) -> (Challenge=w11, Found?=w12)
            Obtain JavaScript Reference(reference in=reference to "Description") -> (javascript reference out=w13)
            case (w12) {
              frame False, Default {
                call "SetInnerHTML"(placeholder=w13, html=w3)
              }
              frame True {
                call "Set Challenge Details.gvi"(Challenge=w11, Desc Ref=w13, Name Ref=reference to unnamed text)
                call "ClearClassFromAll"(className="initially-hidden")
              }
            }
          }
        }
        call "Make CSRF Token.gvi"(Token ID="submit") -> (Token=w5)
        w4 = "Run"
        w6 = s3
        w7 = 1
      }
      frame "Run" {
        event (timeout = s4) {
          on "Upload File" Value changed {
            # Trigger update right away
            call "Set Uppy Core Options.gvi"(max number of files=1, allowed file types=[".llb"]) -> (uppy options out=w14)
            call "Set Uppy Dashboard Options.gvi"(uppy options in=w14, show uppy icon?=FALSE) -> (uppy options out=w15)
            call "Request Files.gvi"(uppy options=w15) -> (file references=w16)
            Array Index(array=w16) -> (out0[_]=w17)
            call "UploadFile.gvi"(File=w17, Challenge ID=s3, CSRF Token=s2) -> (error out=w18)
            case (w18) {
              frame Error, Default {
                Property Node(instance in=w18) -> ("source"=w19)
                One Button Dialog(message=w19)
              }
              frame No Error { }
            }
            w6 = s3
            w5 = s2
            w7 = 1
          }
          on "Timeout" {
            call "GET Submissions.gvi"(Challenge ID=s3) -> (Submissions JSON=w20, Error=w21)
            # Every 4 minutes, automatically check for submission updates.
            case (w21) {
              frame Error, Default {
                Property Node(instance in=w21) -> ("source"=w22)
                call "Debug Log.gvi"(value=w22)
              }
              frame No Error {
                call "Show Submissions.gvi"(Placeholder=reference to "Submissions", Submissions JSON=w20)
              }
            }
            w6 = s3
            w5 = s2
            w7 = 240000
          }
        }
        w4 = "Run"
      }
    }
    next s1 = w4
    next s2 = w5
    next s3 = w6
    next s4 = w7
    stop if FALSE
  }
